# Grasshopper definition Mesh Editor.gh (Grasshopper 1.0.7)
# Copyright: Co-de-iT
# plug-ins: MeshEdit Components, Weaverbird

# automatic reference
# pipeline automatically references geometries from Rhinoceros
# Geometry Pipeline: setup names (or search masks) for:
# 
# . layer name
# . object name
# 
# it is possible to filter by geometry type
# 
# in this case the component is looking for a "work mesh" layer, referencing only mesh type objects.
# 
# These objects will be selected and automatically referenced in Grasshopper
pipeline = GeometryPipeline(
    GroupByLayer=False,
    GroupByType=False,
    IncludeHidden=True,
    IncludeLocked=True,
    LayerFilter="work mesh",
    NameFilter="*",
    SublayerFiltering=False,
    TypeFilter=32)
mesh = Mesh(pipeline)
flip = BooleanToggle(False)

# ----
# set Rhino view Mode to Wireframe
# Join, Weld & Unify Normals
wbjoin = WeaverbirdsJoinMeshesAndWeld(Mesh=mesh, Weld=True)
weldvertices = MeshWeldVertices(Mesh=wbjoin, Tolerance=Slider(0.01, range=0.01..10))  # -> RuntimeMessage, Mesh
unifynormals = MeshUnifyNormals(Mesh=weldvertices.Mesh)

# ----
# Mesh Editor
# 
# automatic mesh reference, cleaning and visual aid for mesh modeling
# 
# code by Alessio Erioli
# 
# v 0.1
panel = Panel("Flip (optional)")

gate = StreamGate(Stream=unifynormals, Gate=flip)  # -> Target0, Target1
flip_2 = MeshFlip(Mesh=gate.Target1)
filter = StreamFilter(Gate=flip, Stream0=gate.Target0, Stream1=flip_2)

# ----
# bake this
mesh_2 = Mesh(filter)
medges = MeshEdges(Mesh=mesh_2)  # -> NakedEdges, InteriorEdges, NonManifoldEdges
mesh_3 = ColourSwatch(SwatchColor=RGB(255, 255, 255))
naked_edges = Slider(3, range=0..5)
clothed_edges = Slider(2, range=0..5)
non_manifold_edges = Slider(5, range=0..5)
naked_edges_2 = ColourSwatch(SwatchColor=RGB(204, 0, 255))
clothed_edges_2 = ColourSwatch(SwatchColor=RGB(0, 0, 0))
non_manifold_edges_2 = ColourSwatch(SwatchColor=RGB(255, 0, 0))
# display only
preview = CustomPreview(Geometry=mesh_2, Material=mesh_3)
entwine = Entwine(Branch00=medges.NakedEdges, Branch01=medges.InteriorEdges, Branch02=medges.NonManifoldEdges, FlattenInputs=True)
entwine_2 = Entwine(Branch00=naked_edges, Branch01=clothed_edges, Branch02=non_manifold_edges, FlattenInputs=True)
entwine_3 = Entwine(Branch00=naked_edges_2, Branch01=clothed_edges_2, Branch02=non_manifold_edges_2, FlattenInputs=True)
list = ValueList({"None": "", "Dot": "0.1 1.0", "Dash": "1.0", "DashDot": "1.0 1.0 0.1 1.0"}, selected="None")
curve_display = CSharpScript(Curve=entwine, Width=entwine_2, Colour=entwine_3, Dash=list)  # inputs Curve: Curve, Width: Int32, Colour: Color, Dash: String
# ---------- curve_display: C# usings ----------
using System.IO;
using System.Linq;
using System.Data;
using System.Drawing;
using System.Reflection;
using System.Windows.Forms;
using System.Xml;
using System.Xml.Linq;
using System.Runtime.InteropServices;

using Rhino.DocObjects;
using Rhino.Collections;
using GH_IO;
using GH_IO.Serialization;
# ---------- curve_display: C# ----------
    // code by David Rutten
    
    if (Curve == null) return;
    if (Width <= 0) return;

    double[] pattern = ParseDashPattern(Dash);
    IEnumerable<Curve> segments = ApplyDashPattern(Curve, pattern);

    _clip = BoundingBox.Union(_clip, Curve.GetBoundingBox(false));
    foreach (Curve segment in segments)
    {
      _curves.Add(segment);
      _colors.Add(Colour);
      _widths.Add(Width);
    }
# ---------- curve_display: C# additional code ----------
  /// <summary>
  /// Parse a dash pattern.
  /// </summary>
  /// <param name="pattern">Pattern to parse.</param>
  /// <returns>Array of dashes and gaps.</returns>
  private double[] ParseDashPattern(string pattern)
  {
    if (string.IsNullOrWhiteSpace(pattern))
      return null;

    string[] fragments = pattern.Split(new char[] {' '});
    if (fragments == null || fragments.Length == 0)
      return null;

    double[] values = new double[fragments.Length];
    for (int i = 0; i < fragments.Length; i++)
    {
      double v;
      if (!double.TryParse(fragments[i], out v))
        throw new Exception(fragments[i] + " is a not a valid number.");

      if (v <= 0.0)
        throw new Exception("Dashes or gaps must have a strictly positive length.");

      values[i] = v;
    }

    return values;
  }
  /// <summary>
  /// Apply a dash+gap pattern to a curve.
  /// </summary>
  private IEnumerable<Curve> ApplyDashPattern(Curve curve, double[] pattern)
  {
    if (pattern == null || pattern.Length == 0)
      return new Curve[] { curve };

    double curveLength = curve.GetLength();
    List<Curve> dashes = new List<Curve>();

    double offset0 = 0.0;
    int index = 0;
    while(true)
    {
      // Get the current dash length.
      double dashLength = pattern[index++];
      if (index >= pattern.Length)
        index = 0;

      // Compute the offset of the current dash from the curve start.
      double offset1 = offset0 + dashLength;
      if (offset1 > curveLength)
        offset1 = curveLength;

      // Solve the curve parameters at the current dash start and end.
      double t0, t1;
      curve.LengthParameter(offset0, out t0);
      curve.LengthParameter(offset1, out t1);

      Curve dash = curve.Trim(t0, t1);
      if (dash != null)
        dashes.Add(dash);

      // Get the current gap length.
      double gapLength = pattern[index++];
      if (index >= pattern.Length)
        index = 0;

      // Set the start of the next dash to be the end of the current
      // dash + the length of the adjacent gap.
      offset0 = offset1 + gapLength;

      // Abort when we've reached the end of the curve.
      if (offset0 >= curveLength)
        break;
    }

    return dashes;
  }

  private BoundingBox _clip;
  private readonly List<Curve> _curves = new List<Curve>();
  private readonly List<Color> _colors = new List<Color>();
  private readonly List<int> _widths = new List<int>();

  /// <summary>
  /// This method will be called once every solution, before any calls to RunScript.
  /// </summary>
  public override void BeforeRunScript()
  {
    _clip = BoundingBox.Empty;
    _curves.Clear();
    _colors.Clear();
    _widths.Clear();
  }

  /// <summary>
  /// Return a BoundingBox that contains all the geometry you are about to draw.
  /// </summary>
  public override BoundingBox ClippingBox
  {
    get { return _clip; }
  }
  /// <summary>
  /// Draw all wires and points in this method.
  /// </summary>
  public override void DrawViewportWires(IGH_PreviewArgs args)
  {
    for (int i = 0; i < _curves.Count; i++)
      args.Display.DrawCurve(_curves[i], _colors[i], _widths[i]);
  }
# ---------- end curve_display ----------
