# Grasshopper definition Util-01_clipping plane anim.gh (Grasshopper 1.0.7)

# how to save the animation frames: Choose the Display Mode you prefer in the Rhino viewport, then, in the slider above:
# 
# right click > Animate...
# 
# Choose you options in the Animate controls panel - make sure the selected viewport is the one you want (check the preview as well) - when you press Ok the animation will start recording.
# 
# You will need a video making tool to convert the frames into a video.
# 
# Hints:
# 
# . for production videos use HD resolution (1920x1080) or 4K if your computer supports it
# . choose the number of frames wisely (25 frames/second > so a 10 seconds video requires 250 frames)
# . save frames in a dedicated folder (do not save directly to the Desktop unless you want to spend 2 hours deleting all the files that are created)
# . the extension you put in the Filename template sets the image format (.jpg or .png are preferred - .png is the one I suggest)
# . the Filename template should have this format:
# 
# <frame name>{0:000}.<frame extension>
# 
# example: Section_{0:000}.png
# 
# the {0:000} part is a format specification to pad all sequential frame numbers so that they are always 3 digits long (ex. 001); this is essential for the correct frame sequence when making the video.
animation_slider = Slider(0, range=0..1)

# ---- group: import a Clipping Plane from Rhino
id = Guid(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)

# ---- group: adjust these until the plane is out of sight
plane_x_dir = Slider(-800, range=-2000..2000)
# convert frames into a video: My preferred choice for making videos from frames in an immediate way is to use Processing (free and cross platform):
# 
# . download Processing from https://processing.org/download/
# . unzip the downloaded file and run Processing
# . go to Tools > Movie Maker
# . just drag and drop the folder where you saved the frames, check that "original resolution" is selected, choose a filename and a destination folder and then just click Create Movie
# 
# Processing saves .mov video files
# 
# Processing is a programming environment so using it for video making tasks sounds really counter-intuitive... but, apart from downloading it the first time, I found it to be the most immediate and easy way to convert frames into videos, especially if your only need is to have the video.
# 
# Saving to frames is a better option than saving directly a video, for many reasons. Just to name a couple:
# . if your computer crashes while exporting the frames you don't have to restart from scratch, you can just restart from the last saved one
# . you can decide where to start/stop the video just by putting the selected frames in a dedicated folder and then make the video from there
# 
# 
# Otherwise the options to convert frames into video may vary (just search on line), also depending on the editing level you want
plane_y_dir = Slider(0, range=-2000..2000)

# ----
section_plane = ValueList({"XY": 0, "XZ": 1, "YZ": 2, "custom": 3}, selected="XZ")
reverse_sequence = ValueList({"no": 0, "yes": 1}, selected="no")
flip_plane = ValueList({"no": 0, "yes": 1}, selected="yes")

visualize_plane = BooleanToggle(True)
visualize_direction = BooleanToggle(True)
direction_display_length = Slider(28.147, range=0..100)

# ---- group: z
pt = Point(Point(0, 0, 1))

# ---- group: y
pt_2 = Point(Point(0, 1, 0))

# ---- group: x
pt_3 = Point(Point(1, 0, 0))

# ---- group: input custom vector here
vec = Vector(Vector(1, 3, -2))

# ---- group: import geometries
geo = Geometry()

# ----
filter = StreamFilter(Gate=section_plane, Stream0=pt, Stream1=pt_2, Stream2=pt_3, Stream3=vec)
rev = Reverse(Vector=filter)
filter_2 = StreamFilter(Gate=flip_plane, Stream0=filter, Stream1=rev)
pt_4 = Point(Point(0, 0, 0))
amp = Amplitude(Vector=filter_2, Amplitude=direction_display_length)
pl = PlaneNormal(Origin=pt_4, ZAxis=filter_2)
filter_3 = StreamFilter(Gate=visualize_direction, Stream1=amp)
bbox = BoundingBox(Content=geo, Plane=pl, UnionBox=True)  # -> Box, Box_2
pt_5 = Point(Point(0, 0, 0))
subtraction = Subtraction(A="1", B=animation_slider)
box = EvaluateBox(Box=bbox.Box, UParameter=0.5, VParameter=0.5, WParameter=0.5)  # -> Plane, Point, Include
vdisex = VectorDisplayEx(Point=pt_5, Vector=filter_3, Colour=ColourSwatch(SwatchColor=RGB(255, 255, 255)), Width=2)
# Clipping plane animation
# 
# animates a clipping plane
# 
# code by Alessio Erioli
# 
# v 0.1
filter_4 = StreamFilter(Gate=reverse_sequence, Stream0=animation_slider, Stream1=subtraction)
# easing animation
graph = GraphMapper(
    filter_4,
    x0=0,
    x1=1,
    y0=0,
    y1=1,
    container_name="Bezier",
    cpx=[0, 0, 0.9923480749, 1],
    cpy=[0, 0.413043499, 0.593565166, 1])
scale = Scale(Geometry=bbox.Box, Center=box.Point, Factor=Slider(1.2, range=1..2))  # -> Geometry, Transform
box_corners = BoxCorners(Box=scale.Geometry)  # -> CornerA, CornerB, CornerC, CornerD, CornerE, CornerF, CornerG, CornerH
vec2pt = Vector2Pt(PointA=box_corners.CornerA, PointB=box_corners.CornerE, Unitize=False)  # -> Vector, Length
c_script = CSharpScript(L=vec2pt.Length)  # -> D; inputs L: Double
# ---------- c_script: C# ----------
    D = new Interval(-L * 0.5, L * 0.5);
# ---------- end c_script ----------
remap = RemapNumbers(Value=graph, Source=Domain(0, 1), Target=c_script)  # -> Mapped, Clipped
amp_2 = Amplitude(Vector=vec2pt.Vector, Amplitude=remap.Mapped)
addition = Addition(A=box.Point, B=amp_2)
pl_origin = PlaneOrigin(Base=pl, Origin=addition)
pln = Plane(pl_origin)
xy = XYPlane(Origin=Point(0, 0, 0))
orient = Orient(Geometry=bbox.Box, Source=pl, Target=xy)  # -> Geometry, Transform
deplane = DeconstructPlane(Plane=pln)  # -> Origin, XAxis, YAxis, ZAxis
boxprop = BoxProperties(Box=orient.Geometry)  # -> Center, Diagonal, Area, Volume, Degeneracy
devec = DeconstructVector(Vector=boxprop.Diagonal)  # -> XComponent, YComponent, ZComponent
amp_3 = Amplitude(Vector=deplane.ZAxis, Amplitude=Slider(-1, range=-1..0))
move = Move(Geometry=pln, Motion=amp_3)  # -> Geometry, Transform

# ---- group: create custom symmetric interval
c_script_2 = CSharpScript(L=devec.XComponent)  # -> D; inputs L: Double; same code as c_script
c_script_3 = CSharpScript(L=devec.YComponent)  # -> D; inputs L: Double; same code as c_script

# ----
panel = Panel(c_script_3)
amp_4 = Amplitude(Vector=deplane.YAxis, Amplitude=plane_y_dir)
amp_5 = Amplitude(Vector=deplane.XAxis, Amplitude=plane_x_dir)
rectangle = Rectangle(Plane=pln, XSize=c_script_2, YSize=c_script_3, Radius=0)  # -> Rectangle, Length
addition_2 = Addition(A=deplane.Origin, B=amp_5, C=amp_4)
scale_2 = Scale(Geometry=rectangle.Rectangle, Center=move.Geometry, Factor=Slider(1.5, range=1..2))  # -> Geometry, Transform
pl_origin_2 = PlaneOrigin(Base=pln, Origin=addition_2)
filter_5 = StreamFilter(Gate=visualize_plane, Stream1=scale_2.Geometry)
c_script_4 = CSharpScript(id=id, P=pl_origin_2)  # inputs id: Guid, P: Plane
# ---------- c_script_4: C# ----------
    Rhino.DocObjects.ObjRef obj = new Rhino.DocObjects.ObjRef(id);
    Rhino.DocObjects.ClippingPlaneObject cpObj = obj.Object() as Rhino.DocObjects.ClippingPlaneObject;
    cpObj.ClippingPlaneGeometry.Plane = P;
    cpObj.CommitChanges();
# ---------- end c_script_4 ----------

# ---- group: visualize plane as planar surface
boundary = BoundarySurfaces(Edges=filter_5)
