# Grasshopper definition Util-02_turntable.gh (Grasshopper 1.0.7)
# Copyright: Co-de-iT

# ---- group: geometry for turntable
geo = Geometry(<mesh referenced from the Rhino model>)

# ---- group: camera parameters / camera plane
xy = XYPlane(Origin=Point(0, 0, 0))

# ---- group: camera parameters
distance_multiplier = Slider(4.863, range=1..10)
lens_min = Panel("21")
lens_max = Panel("120")
lens = Slider(0, range=0..1)

# ----
# how to save the animation frames: Choose the Display Mode you prefer in the Rhino viewport, then, in the slider above:
# 
# right click > Animate...
# 
# Choose you options in the Animate controls panel - make sure the selected viewport is the one you want (check the preview as well) - when you press Ok the animation will start recording.
# 
# You will need a video making tool to convert the frames into a video.
# 
# Hints:
# 
# . for production videos use HD resolution (1920x1080) or 4K if your computer supports it
# . choose the number of frames wisely (25 frames/second > so a 10 seconds video requires 250 frames)
# . save frames in a dedicated folder (do not save directly to the Desktop unless you want to spend 2 hours deleting all the files that are created)
# . the extension you put in the Filename template sets the image format (.jpg or .png are preferred - .png is the one I suggest)
# . the Filename template should have this format:
# 
# <frame name>{0:000}.<frame extension>
# 
# example: Section_{0:000}.png
# 
# the {0:000} part is a format specification to pad all sequential frame numbers so that they are always 3 digits long (ex. 001); this is essential for the correct frame sequence when making the video.
direction = ValueList({"CCW": 0, "CW": 1}, selected="CCW")

adjust_start_point = Slider(0, range=0..1)
slide_camera_plane_along_z = Slider(0, range=-100..300)
slide_target_plane_along_z = Slider(0, range=-100..100)

activate_camera = BooleanToggle(True)
# convert frames into a video: My preferred choice for making videos from frames in an immediate way is to use Processing (free and cross platform):
# 
# . download Processing from https://processing.org/download/
# . unzip the downloaded file and run Processing
# . go to Tools > Movie Maker
# . just drag and drop the folder where you saved the frames, check that "original resolution" is selected, choose a filename and a destination folder and then just click Create Movie
# 
# Processing saves .mov video files
# 
# Processing is a programming environment so using it for video making tasks sounds really counter-intuitive... but, apart from downloading it the first time, I found it to be the most immediate and easy way to convert frames into videos, especially if your only need is to have the video.
# 
# Saving to frames is a better option than saving directly a video, for many reasons. Just to name a couple:
# . if your computer crashes while exporting the frames you don't have to restart from scratch, you can just restart from the last saved one
# . you can decide where to start/stop the video just by putting the selected frames in a dedicated folder and then make the video from there
# 
# 
# Otherwise the options to convert frames into video may vary (just search on line), also depending on the editing level you want
animation_slider = Slider(0, range=0..1)
bbox = BoundingBox(Content=geo, Plane=PlaneXY(0, 0, 0), UnionBox=True)  # -> Box, Box_2
merge = Merge(Data1=lens_min, Data2=lens_max)
boxprop = BoxProperties(Box=bbox.Box)  # -> Center, Diagonal, Area, Volume, Degeneracy
num = Number(merge)
devec = DeconstructVector(Vector=boxprop.Diagonal)  # -> XComponent, YComponent, ZComponent
interp = InterpolateData(Data=num, Parameter=lens, Interpolation=2)
max = Maximum(A=devec.XComponent, B=devec.YComponent)

# ---- group: compensate lens/distance
expression = Expression(d=max, dm=distance_multiplier, l=interp, lmin=lens_min, lMax=lens_max, Expression="d*dm*(l/((lMax+lmin)*0.5))")

# ----
lens_used = Panel(interp)
# Turntable
# 
# generates a turntable animation
# 
# code by Alessio Erioli
# 
# v 0.1
pl_origin = PlaneOrigin(Base=xy, Origin=boxprop.Center)
deplane = DeconstructPlane(Plane=pl_origin)  # -> Origin, XAxis, YAxis, ZAxis
amp = Amplitude(Vector=deplane.ZAxis, Amplitude=slide_camera_plane_along_z)
amp_2 = Amplitude(Vector=deplane.ZAxis, Amplitude=slide_target_plane_along_z)
move = Move(Geometry=pl_origin, Motion=amp)  # -> Geometry, Transform
move_2 = Move(Geometry=boxprop.Center, Motion=amp_2)  # -> Geometry, Transform
cir = Circle(Plane=move.Geometry, Radius=expression)
seam = Seam(Curve=reparameterize(cir), Seam=adjust_start_point)
flip = FlipCurve(Curve=seam)  # -> Curve, Flag
filter = StreamFilter(Gate=direction, Stream0=seam, Stream1=flip.Curve)
eval = EvaluateCurve(Curve=reparameterize(filter), Parameter=animation_slider)  # -> Point, Tangent, Angle
c_script = CSharpScript(location=eval.Point, target=move_2.Geometry, lens=interp, up=deplane.ZAxis, run=activate_camera)  # inputs location: Point3d, target: Point3d, lens: Double, up: Vector3d, run: Boolean
# ---------- c_script: C# usings ----------
using System.IO;
using System.Linq;
using System.Data;
using System.Drawing;
using System.Reflection;
using System.Windows.Forms;
using System.Xml;
using System.Xml.Linq;
using System.Runtime.InteropServices;

using Rhino.DocObjects;
using Rhino.Collections;
using GH_IO;
using GH_IO.Serialization;
# ---------- c_script: C# ----------
    Component.Message = "Set Camera";

    if (run){
      //Get current viewport
      vp = Rhino.RhinoDoc.ActiveDoc.Views.ActiveView.ActiveViewport;
      //Set new camera
      vp.SetCameraLocations(target, location);
      vp.CameraUp = up;
      vp.ChangeToPerspectiveProjection(true, lens);
    }
# ---------- c_script: C# additional code ----------
  //To get and set camera properties
  Rhino.Display.RhinoViewport vp;
# ---------- end c_script ----------
