# Grasshopper definition day 01-01_actual.gh (Grasshopper 1.0.7)
# Copyright: Co-de-iT
# plug-ins: Anemone, Bifocals, Noise 4D

Y = UnitY(Factor=1)
X = UnitX(Factor=1)
pt = Point(Point(0, 0.9040846525, 0))
pt_2 = Point(Point(0, 0, 0))
merge = Merge(Data1=X, Data2=Y)  # -> simplify(graft(Result))
merge_2 = Merge(Data1=pt_2, Data2=pt)  # -> simplify(graft(Result))
X_2 = XSize(Domain(-1, 1))
pt_3 = Point(Point(0, 0, 0))
number_slider = Slider(30, range=0..200)
rectangle = Rectangle(Plane=PlaneXY(0, 0, 0), XSize=X_2, YSize=X_2, Radius=0)  # -> Rectangle, Length
X_3 = UnitX(Factor=1)
pt_4 = Point(Point(0, 0, 0))
number_slider_2 = Slider(2, range=0..2)
X_4 = UnitX(Factor=1)
X_5 = UnitX(Factor=1)
number_slider_3 = Slider(0.151, range=0..1)
pop2d = Populate2D(Region={Plane=PlaneXY(0, 0, 0), Size=Domain2(u=0..20, v=0..10)}, Count=number_slider, Seed=1)
pop2d_2 = Populate2D(Region=rectangle.Rectangle, Count=number_slider, Seed=1)
loop_start = LoopStart(N=Slider(1000, range=0..1000), T=Button(), D0=pt_3, D1=X_4)  # -> port, Counter, Data, Data_2; disabled
mod = Modulus(A=loop_start.Counter, B="100")
panel = Panel(mod)
move = Move(Geometry=pt_3, Motion=X_5)  # -> Geometry, Transform
number_slider_4 = Slider(100, range=0..1000)
number_slider_5 = Slider(0.159, range=0..3.142)
X_6 = UnitX(Factor=1)
amp = Amplitude(Vector=pop2d_2, Amplitude=number_slider_2)
panel_2 = Panel(loop_start.Counter)
loop_start_2 = LoopStart(N=Slider(100, range=0..1000), T=Button(), D0=pt_4, D1=X_3)  # -> port, Counter, Data, Data_2; disabled
multiplication = Multiplication(A=mod, B=Slider(0.093, range=0..1))
max_angle = Slider(0.383, range=0..1.571)
Z = UnitZ(Factor=1)
# <title>
# 
# <description>
# 
# code by Alessio Erioli
# 
# v 0.1
move_2 = Move(Geometry=move.Geometry, Motion=X_6)  # -> Geometry, Transform
random = Random(Range="2000", Number=1, Seed=loop_start_2.Counter, Integers=True)
panel_3 = Panel(loop_start_2.Counter)
vdisex = VectorDisplayEx(Point=pop2d, Vector=amp, Colour=RGB(0, 0, 0), Width=2)
vrot = Rotate(Vector=loop_start.Data_2, Axis=Z, Angle=multiplication)
loop_start_3 = LoopStart(N=number_slider_4, T=Button(), D0=simplify(graft(pop2d)), D1=simplify(graft(amp)))  # -> port, Counter, Data, Data_2; disabled
panel_4 = Panel(multiplication)
random_2 = Random(Range=Domain(0, 1), Number=1, Seed=random)
move_3 = Move(Geometry=loop_start.Data, Motion=vrot)  # -> Geometry, Transform
expression = Expression(x=random_2, y=max_angle, Expression="((x*2)-1)*y")
panel_5 = Panel(loop_start_3.Counter)
lng = ListLength(List=flatten(pop2d))
X_7 = UnitX(Factor=1)
Z_2 = UnitZ(Factor=1)
loop_end = LoopEnd(
    port=loop_start.port,
    Exit=False,
    Data=move_3.Geometry,
    Data_2=vrot,
    TimeOutVal=0,
    pausedState=False,
    state="Constant & Record")  # -> flatten(D0), flatten(D1)
item = ListItem(List=loop_start_3.Data, Index="-1", Wrap=True)

perlin = PerlinNoise(Values=item, Time=Slider(1.669, range=0..10), Scale=Slider(0.05, range=0..1))
pi = Pi(Factor=1)
Z_3 = UnitZ(Factor=1)
multiplication_2 = Multiplication(A=perlin, B=pi, C=Slider(0.15, range=0..10))
X_8 = UnitX(Factor=1)
vrot_2 = Rotate(Vector=X_8, Axis=Z_3, Angle=multiplication_2)
amp_2 = Amplitude(Vector=vrot_2, Amplitude=Slider(0.389, range=0..1))

item_2 = ListItem(List=loop_start_3.Data_2, Index="-1", Wrap=True)
vrot_3 = Rotate(Vector=loop_start_2.Data_2, Axis=Z_2, Angle=expression)
pt_5 = Point(Point(0, 0, 0))
subtraction = Subtraction(A=number_slider_4, B=loop_start_3.Counter)
intcrv = Interpolate(Vertices=loop_end.D0, Degree=3, Periodic=False, KnotStyle=1)  # -> Curve, Length, Domain
division = Division(A=subtraction, B=number_slider_4)
max_angle_2 = Slider(0.383, range=0..1.571)
amp_3 = Amplitude(Vector=vrot_3, Amplitude=Slider(0.25, range=0..2))
random_3 = Random(Range="2000", Number=lng, Seed=loop_start_3.Counter, Integers=True)
vdisex_2 = VectorDisplayEx(Point=loop_end.D0, Vector=loop_end.D1, Colour=RGB(0, 0, 0), Width=2)
graph = GraphMapper(division, x0=0, x1=1, y0=0, y1=1, container_name="Sine", Equation_px=[0, 1], Equation_py=[0, 1])
random_4 = Random(Range=Domain(0, 1), Number=1, Seed=random_3)
move_4 = Move(Geometry=loop_start_2.Data, Motion=amp_3)  # -> Geometry, Transform
expression_2 = Expression(x=random_4, y=max_angle_2, Expression="((x*2)-1)*y")
loop_end_2 = LoopEnd(
    port=loop_start_2.port,
    Exit=False,
    Data=move_4.Geometry,
    Data_2=amp_3,
    TimeOutVal=0,
    pausedState=False,
    state="Constant & Record")  # -> D0, D1
Z_4 = UnitZ(Factor=1)
multiplication_3 = Multiplication(A=number_slider_2, B=graph)
vrot_4 = Rotate(Vector=item_2, Axis=Z_4, Angle=multiplication_2)
vdisex_3 = VectorDisplayEx(Point=loop_end_2.D0, Vector=loop_end_2.D1, Colour=RGB(0, 0, 0), Width=2)
amp_4 = Amplitude(Vector=vrot_4, Amplitude=multiplication_3)
panel_6 = Panel(multiplication_3)
move_5 = Move(Geometry=item, Motion=amp_4)  # -> Geometry, Transform
merge_3 = Merge(Data1=loop_start_3.Data, Data2=simplify(move_5.Geometry))
merge_4 = Merge(Data1=loop_start_3.Data_2, Data2=simplify(amp_4))

# ---- group: Running...
loop_end_3 = LoopEnd(
    port=loop_start_3.port,
    Exit=False,
    Data=simplify(merge_3),
    Data_2=simplify(merge_4),
    TimeOutVal=0,
    pausedState=False,
    state="Constant output")  # -> D0, D1

# ----
viewer = ParamViewer(loop_end_3.D0)
vdisex_4 = VectorDisplayEx(Point=loop_end_3.D0, Vector=loop_end_3.D1, Colour=RGB(0, 0, 0), Width=2)
pline = PolyLine(Vertices=loop_end_3.D0, Closed=False)  # disabled

# ---- group: visualizing Noise function
number_slider_6 = Slider(94, range=0..100)
number_slider_7 = Slider(32, range=0..100)
number_slider_8 = Slider(3, range=1..3)
pt_6 = Point(Point(36.27304395, -13.63765163, 0))
multiplication_4 = Multiplication(A=number_slider_7, B=number_slider_8)
multiplication_5 = Multiplication(A=number_slider_6, B=number_slider_8)
rectangle_2 = Rectangle(Plane=pt_6, XSize=number_slider_6, YSize=number_slider_7, Radius=0)  # -> Rectangle, Length
mplane = MeshPlane(Boundary=rectangle_2.Rectangle, WidthCount=multiplication_5, HeightCount=multiplication_4)  # -> Mesh, Area
demesh = DeconstructMesh(Mesh=mplane.Mesh)  # -> Vertices, Faces, Colours, Normals; disabled

# ----
perlin_2 = PerlinNoise(Values=demesh.Vertices, Time=Slider(1.669, range=0..10), Scale=Slider(0.051, range=0..1))
pi_2 = Pi(Factor=1)
Z_5 = UnitZ(Factor=1)
multiplication_6 = Multiplication(A=perlin_2, B=pi_2, C=Slider(4.546, range=0..10))
X_9 = UnitX(Factor=1)
vrot_5 = Rotate(Vector=X_9, Axis=Z_5, Angle=multiplication_6)
amp_5 = Amplitude(Vector=vrot_5, Amplitude=Slider(0.389, range=0..1))

# ---- group: visualizing Noise function (continued)
gradient = Gradient(LowerLimit="-1", UpperLimit=1, Parameter=perlin_2, stops=[0: RGB(0, 0, 0), 1: RGB(255, 255, 255)])
conmesh = ConstructMesh(Vertices=demesh.Vertices, Faces=demesh.Faces, Colours=gradient)
vdisex_5 = VectorDisplayEx(Point=demesh.Vertices, Vector=amp_5, Colour=RGB(0, 0, 0), Width="1")
