# Grasshopper definition day 01-02_actual.gh (Grasshopper 1.0.7)
# Copyright: Co-de-iT

c_script = CSharpScript(x=Slider(5.907, range=0..10), y=Slider(4.983, range=0..10), z=Slider(6.573, range=0..10))  # -> out, P; inputs x: Double, y: Double, z: Double
# ---------- c_script: C# ----------
// Point3d
    P = new Point3d(x, y, z);
# ---------- end c_script ----------
c_script_2 = CSharpScript(x="Alessio", y="937")  # -> out, A
# ---------- c_script_2: C# ----------
    Print("Hello World!");
    // Console.WriteLine("Hello World!");
    Print("Hello {0}, 'tis a fine day to learn C#!\n\n And at the tender age of {1}!", x, y);
# ---------- end c_script_2 ----------
c_script_3 = CSharpScript()  # -> out, A, B, C, D, E, F
# ---------- c_script_3: C# ----------
    // primitive types
    int myInt;
    myInt = 5;
    double myDouble = 3.14;
    bool myBool = true; // false
    
    // class              object
    Point3d myPoint = new Point3d(3, 4, 5);
    
    /*
  classes
  
  members/fields - describe its characteristics - what it is
  
  methods/actions/behaviors/functions - what it can do
  
  */
    
    A = myInt;
    B = myDouble;
    C = myBool;
    D = myPoint;
    E = myPoint.Y;
    F = myPoint.DistanceTo(new Point3d());
# ---------- end c_script_3 ----------
c_script_4 = CSharpScript(A=Slider(0.502, range=0..1), B=Slider(0.25, range=0..1))  # -> out, S; inputs A: Double, B: Double
# ---------- c_script_4: C# ----------
            /*
  int - integer nums
  double - real
  bool - true/false

  */
    //S = A + B;
    PrintSum(A, B);
    S = Sum(A, B); // = assigned to <=
# ---------- c_script_4: C# additional code ----------
  
  // function declaration
  double Sum(double f, double y)
  {
    double xplusy; // variable declaration
    xplusy = f + y;
    return xplusy;
  }

  void PrintSum(double x, double y)
  {
    Print("The sum of the two numbers is: {0}", x + y);
  }
# ---------- end c_script_4 ----------
# <title>
# 
# <description>
# 
# code by Alessio Erioli
# 
# v 0.1
panel = Panel(c_script_2.out)
pt = Point(c_script_3.D)
bool = Boolean(c_script_3.C)
num = Number(c_script_3.B)
int = Integer(c_script_3.A)
panel_2 = Panel(c_script_4.S)
panel_3 = Panel(c_script_4.out)
expression = Expression(Expression="Format(\"{0}, {1}\", x, y)")
panel_4 = Panel(int)
panel_5 = Panel(c_script_3.F)
