# Grasshopper definition CS_03_classes.gh (Grasshopper 1.0.7)
# Copyright: Co-de-iT

reset = Button()
go = BooleanToggle(False)
reset_2 = Button()
reset_3 = Button()
reset_4 = Button()
pop2d = Populate2D(Region={Plane=PlaneXY(0, 0, 0), Size=Domain2(u=0..20, v=0..10)}, Count=Slider(30, range=2..100), Seed=1)
pop2d_2 = Populate2D(Region={Plane=PlaneXY(0, 0, 0), Size=Domain2(u=0..20, v=0..10)}, Count=Slider(30, range=2..100), Seed=1)
pop2d_3 = Populate2D(Region={Plane=PlaneXY(0, 0, 0), Size=Domain2(u=0..20, v=0..10)}, Count=Slider(30, range=2..100), Seed=1)

# ---- group: introducing stop/go
c_script = CSharpScript(P=pop2d_2, reset=reset, go=go)  # -> out, A, trails; inputs P: list of Point3d, reset: Boolean, go: Boolean; disabled
# ---------- c_script: C# ----------
    if (reset || bugs.Count == 0 || P.Count != bugs.Count) initBugs(P);

    // updates our JitterBugs
    foreach(JitterBug a in bugs) a.update();
    for(int i = 0; i < bugs.Count; i++)
    {
      pts[i] = bugs[i].pos;
      trs[i] = bugs[i].trail;
    }

    // expiring solution equals to a timer forcing the update
    if (go) Component.ExpireSolution(true);

    A = pts;
    trails = trs;
# ---------- c_script: C# additional code ----------
  // instantiate object from the class
  //JitterBug a;
  List<JitterBug> bugs = new List<JitterBug>();
  List<Point3d> pts = new List<Point3d>();
  List<Polyline> trs = new List<Polyline>();

  // whenever we want to use in a class something declared outside we should declare it as static
  //static Random rnd = new Random(); // a random class


  // initialization function
  public void initBugs(List<Point3d> P)
  {
    bugs.Clear();
    pts.Clear();
    trs.Clear();
    foreach(Point3d p in P)
    {
      bugs.Add(new JitterBug(p));
      pts.Add(p);
      trs.Add(new Polyline());
    }

  }


  // JitterBug class

  public class JitterBug
  {

    // static field
    static int nBugs = 0;

    // instance fields of the class
    public Point3d pos;
    public Vector3d vel;
    public Polyline trail;
    int id;
    Random rnd;

    // constructor(s)
    public JitterBug()
    {
      id = nBugs;
      rnd = new Random(id);
      pos = new Point3d(rnd.NextDouble() - 0.5, rnd.NextDouble() - 0.5, 0);
      vel = new Vector3d(rnd.NextDouble() - 0.5, rnd.NextDouble() - 0.5, 0) * 0.25;
      trail = new Polyline();
      nBugs++;
    }

    public JitterBug(Point3d pos){
      id = nBugs;
      rnd = new Random(id);
      this.pos = pos;
      vel = new Vector3d(rnd.NextDouble() - 0.5, rnd.NextDouble() - 0.5, 0) * 0.25;
      trail = new Polyline();
      nBugs++;
    }

    // methods

    public void update()
    {
      calcVel();
      move();
    }

    void calcVel()
    {
      vel.Rotate((rnd.NextDouble() - 0.5) * Math.PI * 0.6, Vector3d.ZAxis);
    }

    // check what changes if we invoke calcVel2
    void calcVel2()
    {
      vel = new Vector3d(rnd.NextDouble() - 0.5, rnd.NextDouble() - 0.5, 0);
    }


    void move()
    {
      trail.Add(pos);
      pos += vel;
    }

  }
# ---------- end c_script ----------

# ---- group: single JitterBug
# jitterbug class
c_script_2 = CSharpScript(reset=reset_4)  # -> out, A; inputs reset: Boolean; disabled
# ---------- c_script_2: C# ----------
    if (reset || a == null) a = new JitterBug();

    // updates our JitterBug
    a.update();

    // expiring solution equals to a timer forcing the update
    Component.ExpireSolution(true);

    A = a.pos;
# ---------- c_script_2: C# additional code ----------
  // instantiate object from the class
  JitterBug a;

  public class JitterBug
  {

    // fields of the class
    public Point3d pos;
    public Vector3d vel;
    Random rnd;

    // constructor
    public JitterBug()
    {
      rnd = new Random();
      pos = new Point3d(rnd.NextDouble() - 0.5, rnd.NextDouble() - 0.5, 0);
      vel = new Vector3d(rnd.NextDouble() - 0.5, rnd.NextDouble() - 0.5, 0) * 0.25;

    }

    // methods

    public void update()
    {
      calcVel();
      move();
    }

    void calcVel()
    {
      vel.Rotate((rnd.NextDouble() - 0.5) * Math.PI * 0.6, Vector3d.ZAxis);
    }

    // check what changes if we invoke calcVel2
    void calcVel2()
    {
      vel = new Vector3d(rnd.NextDouble() - 0.5, rnd.NextDouble() - 0.5, 0);
    }

    void move()
    {
      pos += vel;
    }

  }
# ---------- end c_script_2 ----------

# ---- group: multiple instances
c_script_3 = CSharpScript(P=pop2d_3, reset=reset_2)  # -> out, A; inputs P: list of Point3d, reset: Boolean; disabled
# ---------- c_script_3: C# ----------
    if (reset || bugs.Count == 0 || P.Count != bugs.Count) initBugs(P);

    // updates our JitterBug
    foreach(JitterBug a in bugs) a.update();
    
    // extract positions for output
    for(int i = 0; i < bugs.Count; i++)
    {
      pts[i] = bugs[i].pos;
    }

    // expiring solution equals to a timer forcing the update
    Component.ExpireSolution(true);

    A = pts;
# ---------- c_script_3: C# additional code ----------
  // instantiate object from the class
  //JitterBug a;
  List<JitterBug> bugs = new List<JitterBug>();
  List<Point3d> pts = new List<Point3d>();


  // initialization function
  public void initBugs(List<Point3d> P)
  {
    bugs.Clear();
    pts.Clear();
    foreach(Point3d p in P)
    {
      bugs.Add(new JitterBug(p));
      pts.Add(p);
    }

  }


  // JitterBug class

  public class JitterBug
  {

    // static field
    static int nBugs = 0;

    // instance fields of the class
    public Point3d pos;
    public Vector3d vel;
    int id;
    Random rnd;

    // constructor(s)
    public JitterBug()
    {
      id = nBugs;
      rnd = new Random(id);
      pos = new Point3d(rnd.NextDouble() - 0.5, rnd.NextDouble() - 0.5, 0);
      vel = new Vector3d(rnd.NextDouble() - 0.5, rnd.NextDouble() - 0.5, 0) * 0.25;
      nBugs++;
    }

    public JitterBug(Point3d pos){
      id = nBugs;
      rnd = new Random(id);
      this.pos = pos;
      vel = new Vector3d(rnd.NextDouble() - 0.5, rnd.NextDouble() - 0.5, 0) * 0.25;
      nBugs++;
    }

    // methods

    public void update()
    {
      calcVel();
      move();
    }

    void calcVel()
    {
      vel.Rotate((rnd.NextDouble() - 0.5) * Math.PI * 0.6, Vector3d.ZAxis);
    }

    // check what changes if we invoke calcVel2
    void calcVel2()
    {
      vel = new Vector3d(rnd.NextDouble() - 0.5, rnd.NextDouble() - 0.5, 0);
    }

    void move()
    {
      pos += vel;
    }

  }
# ---------- end c_script_3 ----------

# ---- group: multiple instances - records trails
c_script_4 = CSharpScript(P=pop2d, reset=reset_3)  # -> out, A, trails; inputs P: list of Point3d, reset: Boolean; disabled
# ---------- c_script_4: C# ----------
    if (reset || bugs.Count == 0 || P.Count != bugs.Count) initBugs(P);

    // updates our JitterBugs
    foreach(JitterBug a in bugs) a.update();

    // extract positions and trails for output
    for(int i = 0; i < bugs.Count; i++)
    {
      pts[i] = bugs[i].pos;
      trs[i] = bugs[i].trail;
    }

    // expiring solution equals to a timer forcing the update
    Component.ExpireSolution(true);

    A = pts;
    trails = trs;
# ---------- c_script_4: C# additional code ----------
  // instantiate object from the class
  //JitterBug a;
  List<JitterBug> bugs = new List<JitterBug>();
  List<Point3d> pts = new List<Point3d>();
  List<Polyline> trs = new List<Polyline>();

  // whenever we want to use in a class something declared outside we should declare it as static
  //static Random rnd = new Random(); // a random class


  // initialization function
  public void initBugs(List<Point3d> P)
  {
    bugs.Clear();
    pts.Clear();
    trs.Clear();
    foreach(Point3d p in P)
    {
      bugs.Add(new JitterBug(p));
      pts.Add(p);
      trs.Add(new Polyline());
    }

  }


  // JitterBug class

  public class JitterBug
  {

    // static field
    static int nBugs = 0;

    // instance fields of the class
    public Point3d pos;
    public Vector3d vel;
    public Polyline trail;
    int id;
    Random rnd;

    // constructor(s)
    public JitterBug()
    {
      id = nBugs;
      rnd = new Random(id);
      pos = new Point3d(rnd.NextDouble() - 0.5, rnd.NextDouble() - 0.5, 0);
      vel = new Vector3d(rnd.NextDouble() - 0.5, rnd.NextDouble() - 0.5, 0) * 0.25;
      trail = new Polyline();
      nBugs++;
    }

    public JitterBug(Point3d pos){
      id = nBugs;
      rnd = new Random(id);
      this.pos = pos;
      vel = new Vector3d(rnd.NextDouble() - 0.5, rnd.NextDouble() - 0.5, 0) * 0.25;
      trail = new Polyline();
      nBugs++;
    }

    // methods

    public void update()
    {
      calcVel();
      move();
    }

    void calcVel()
    {
      vel.Rotate((rnd.NextDouble() - 0.5) * Math.PI * 0.6, Vector3d.ZAxis);
    }

    // check what changes if we invoke calcVel2
    void calcVel2()
    {
      vel = new Vector3d(rnd.NextDouble() - 0.5, rnd.NextDouble() - 0.5, 0);
    }


    void move()
    {
      trail.Add(pos);
      pos += vel;
    }

  }
# ---------- end c_script_4 ----------

# ----
cir = Circle(Plane=c_script_3.A, Radius=0.25)
cir_2 = Circle(Plane=c_script_2.A, Radius=0.25)
cir_3 = Circle(Plane=c_script.A, Radius=0.25)
crv = Curve(c_script.trails)
cir_4 = Circle(Plane=c_script_4.A, Radius=0.25)
crv_2 = Curve(c_script_4.trails)
preview = CustomPreview(
    Geometry=cir,
    Material={diffuse=RGB(221, 160, 221), emission=RGB(66, 48, 66), shine=0.5, specular=RGB(255, 255, 255), transparency=0})
# CS_03_classes
# 
# Classes
# 
# code by Alessio Erioli
# 
# v 0.1
preview_2 = CustomPreview(
    Geometry=cir_2,
    Material={diffuse=RGB(221, 160, 221), emission=RGB(66, 48, 66), shine=0.5, specular=RGB(255, 255, 255), transparency=0})
preview_3 = CustomPreview(
    Geometry=cir_3,
    Material={diffuse=RGB(221, 160, 221), emission=RGB(66, 48, 66), shine=0.5, specular=RGB(255, 255, 255), transparency=0})
preview_4 = CustomPreview(Geometry=crv, Material=ColourSwatch(SwatchColor=RGB(112, 112, 112)))
preview_5 = CustomPreview(
    Geometry=cir_4,
    Material={diffuse=RGB(221, 160, 221), emission=RGB(66, 48, 66), shine=0.5, specular=RGB(255, 255, 255), transparency=0})
preview_6 = CustomPreview(Geometry=crv_2, Material=ColourSwatch(SwatchColor=RGB(112, 112, 112)))
