# Grasshopper definition day 02_00_actual.gh (Grasshopper 1.0.7)
# Copyright: Co-de-iT

number_slider = Slider(0.25, range=0..10)
# value types
c_script = CSharpScript(x=Slider(0.25, range=0..1))  # -> out, A, B; inputs x: Double
# ---------- c_script: C# ----------
    double b;
    
    b = x;
    // x = x + 2;
    x += 2;
    
    A = x;
    B = b;
# ---------- end c_script ----------
c_script_2 = CSharpScript(x=number_slider)  # -> out, A, B; inputs x: Double
# ---------- c_script_2: C# ----------
    MySphere s1, s2; // multiple var declaration

    s1 = new MySphere(new Point3d(x, 0, 0), 1.0);
    s2 = s1;

    s1.Center += new Point3d(0.5, 0, 0);

    A = s1.Geometry();
    B = s2.Geometry();
# ---------- c_script_2: C# additional code ----------
  public class MySphere
  {
    // fields/members/parameters
    public Point3d Center;
    public double Radius;

    // constructor
    public MySphere(Point3d outCenter, double outRadius)
    {
      Center = outCenter;
      Radius = outRadius;
    }


    // behaviors/methods/actions/functions

    public Sphere Geometry()
    {
      return new Sphere(Center, Radius);
    }

  }
# ---------- end c_script_2 ----------
c_script_3 = CSharpScript(x=number_slider)  # -> out, A, B; inputs x: Double
# ---------- c_script_3: C# ----------
    Sphere s1, s2; // multiple var declaration
    
    s1 = new Sphere(new Point3d(x, 0, 0), 1.0);
    s2 = s1;
    
    s1.Center += new Point3d(0.5, 0, 0);
    
    A = s1;
    B = s2;
# ---------- c_script_3: C# additional code ----------
  class MySphere
  {
  // fields/members/parameters
    Point3d Center;
    double Radius;
    
    // constructor
    MySphere(Point3d outCenter, double outRadius)
    {
      Center = outCenter;
      Radius = outRadius;
    }
    
    
    // behaviors/methods/actions/functions
    
    Sphere Geometry()
    {
      return new Sphere(Center, Radius);
    }
    
  }
# ---------- end c_script_3 ----------
panel = Panel(c_script.B)
# <title>
# 
# <description>
# 
# code by Alessio Erioli
# 
# v 0.1
panel_2 = Panel(c_script.A)
srf = Surface(c_script_2.A)
srf_2 = Surface(c_script_2.B)
srf_3 = Surface(c_script_3.A)
srf_4 = Surface(c_script_3.B)
timer = Timer(TimerInterval=20, Target=[c_script_7, c_script_4, c_script_5])  # disabled
c_script_4 = CSharpScript(reset=Toggle(True))  # -> out, A; inputs reset: Boolean
# ---------- c_script_4: C# ----------
    if (reset) count = 0;
    A = count++;
# ---------- c_script_4: C# additional code ----------
  int count;
# ---------- end c_script_4 ----------
c_script_5 = CSharpScript(reset=Button(), go=Toggle(False))  # -> out, A; inputs reset: Boolean, go: Boolean
# ---------- c_script_5: C# ----------
    if (reset) count = 0;
    if (go) count++;
    A = count;
# ---------- c_script_5: C# additional code ----------
  int count;
# ---------- end c_script_5 ----------
c_script_6 = CSharpScript(reset=Button(), go=Toggle(False))  # -> out, A; inputs reset: Boolean, go: Boolean
# ---------- c_script_6: C# ----------
   /*
  boolean operators
  && and
  || or
  ! not - if(!go)
  */
   
    if (reset || count == 200) count = 0;
    if (go && count < 200)
    {
      count++;
      Component.ExpireSolution(true);
    }
    A = count;
# ---------- c_script_6: C# additional code ----------
  int count;
# ---------- end c_script_6 ----------
c_script_7 = CSharpScript()  # -> out, A
# ---------- c_script_7: C# ----------
    int count = 0;
    A = ++count;
# ---------- end c_script_7 ----------
panel_3 = Panel(c_script_4.A)
panel_4 = Panel(c_script_7.A)
panel_5 = Panel(c_script_5.A)
panel_6 = Panel(c_script_6.A)
