# Grasshopper definition day 02_01_actual.gh (Grasshopper 1.0.7)
# Copyright: Co-de-iT

number_slider = Slider(20, range=1..100)
X = XSize(Domain(-1, 1))
rectangle = Rectangle(Plane=PlaneXY(0, 0, 0), XSize=X, YSize=X, Radius=0)  # -> Rectangle, Length
# https://developer.rhino3d.com/ - Rhino developer home page
# 
# https://developer.rhino3d.com/api/ - API references
# 
# http://developer.rhino3d.com/guides/rhinocommon/what-is-rhinocommon/
# 
# https://developer.rhino3d.com/api/RhinoCommon - RhinoCommon SDK
# 
# https://developer.rhino3d.com/api/grasshopper - Grasshopper SDK
pop2d = Populate2D(Region={Plane=PlaneXY(0, 0, 0), Size=Domain2(u=0..20, v=0..10)}, Count=number_slider, Seed=1)
pop2d_2 = Populate2D(Region=rectangle.Rectangle, Count=number_slider, Seed=1)
unit = UnitVector(Vector=pop2d_2)
amp = Amplitude(Vector=pop2d_2, Amplitude=Slider(0.638, range=0..1))
pt = Point(pop2d)
reset = Button()
go = BooleanToggle(False)
vdisex = VectorDisplayEx(Point=pop2d_2, Vector=unit, Colour=RGB(0, 0, 0), Width=2)
X_2 = UnitX(Factor=1)
c_script = CSharpScript(reset=reset, go=go, P=pop2d, V=amp)  # -> out, Ap, Av; inputs reset: Boolean, go: Boolean, P: Point3d, V: Vector3d
# ---------- c_script: C# ----------
    // initialization
    if(reset || a == null)
    {
      a = new Agent(P, V); // instantiation
    }
    
    // update
    if(go)
    {
      a.UpdateVelocityAndPosition();
      Component.ExpireSolution(true);
    }

    // output
    Ap = a.Position;
    Av = a.Velocity;
    
    /*
  if()
  {....}
  else
  {....}
  
  for(....)
  {...}
  
  void MyFunction(params)
  {...}
  
  class MyClass
  {...}
  */
# ---------- c_script: C# additional code ----------
  Agent a; // declaration

  public class Agent
  {
    //fields
    public Point3d Position;
    public Vector3d Velocity;

    // constructor
    public Agent(Point3d Position, Vector3d Velocity)
    {
      this.Position = Position;
      this.Velocity = Velocity;
    }
    // methods

    public void UpdateVelocityAndPosition()
    {
      Position += Velocity;
    }
  }
# ---------- end c_script ----------
# <title>
# 
# <description>
# 
# code by Alessio Erioli
# 
# v 0.1
# V
# P
vdisex_2 = VectorDisplayEx(Point=c_script.Ap, Vector=c_script.Av, Colour=RGB(0, 0, 0), Width=2)
