# Grasshopper definition AgentSystem.gh (Grasshopper 1.0.7)
# Copyright: Co-de-iT
# plug-ins: FileToScript

dir_type = ValueList({"desktop": 0, "documents": 1, "GH file path": 2, "C:": 3}, selected="GH file path")
f_pathg = PathGenerator(type=dir_type, subDir="AgentSystem")  # -> dir; inputs type: Int32, subDir: String
# ---------- f_pathg: C# ----------
                           /*
    froGH - a sparse collection of (in)utilities for Grasshopper

    Path Generator
    code by Alessio Erioli - value list generation based on code by James Ramsden

    froGH by Co-de-iT is licensed under a Creative Commons Attribution 4.0 International License.
    http://creativecommons.org/licenses/by/4.0/

    */
    initComp();


    String S = "";
    String root = "";
    String end = "\\";
    String eol = Environment.NewLine;

    // __________________ autoList part __________________

    // variable for the list
    Grasshopper.Kernel.Special.GH_ValueList vList;
    // tries to cast input as list
    try{

      // if the list is not the first parameter then change Input[0] to the corresponding value
      vList = (Grasshopper.Kernel.Special.GH_ValueList) Component.Params.Input[0].Sources[0];
      // Print("value list connected");
      // check if the list must be created
      //if (vList.NickName != "dir type"){
      if (!vList.NickName.Equals("dir type")){
        vList.ClearData();
        vList.ListItems.Clear();
        vList.NickName = "dir type";
        var item1 = new Grasshopper.Kernel.Special.GH_ValueListItem("desktop", "0");
        var item2 = new Grasshopper.Kernel.Special.GH_ValueListItem("documents", "1");
        var item3 = new Grasshopper.Kernel.Special.GH_ValueListItem("GH file path", "2");
        var item4 = new Grasshopper.Kernel.Special.GH_ValueListItem("C:", "3");
        vList.ListItems.Add(item1);
        vList.ListItems.Add(item2);
        vList.ListItems.Add(item3);
        vList.ListItems.Add(item4);

        vList.ListItems[0].Value.CastTo(out type);
      }
    }
    catch{
      // handles anything that is not a value list
    }


    switch(type){
      case 0:
        root = Environment.GetFolderPath(Environment.SpecialFolder.Desktop) + end;
        S = "Desktop";
        break;
      case 1:
        root = Environment.GetFolderPath(Environment.SpecialFolder.MyDocuments) + end;
        S = "Documents";
        break;
      case 2:
        GH_Document ghDoc = owner.OnPingDocument();

        if (ghDoc.IsFilePathDefined)
        {
          int nameLen = ghDoc.DisplayName.TrimEnd('*').Length + 3; // +3 accounts for the '.gh' extension
          int fileLen = ghDoc.FilePath.TrimEnd('*').Length;

          //F = ghDoc.DisplayName.TrimEnd('*');
          root = ghDoc.FilePath.Substring(0, fileLen - nameLen);
          //root = gh_d.FilePath;
          S = "GH File path";
        }
        else
        {
          Print("No path defined. Saving to Desktop until then");
          root = Environment.GetFolderPath(Environment.SpecialFolder.Desktop);
          S = "Desktop";
        }
        break;
      case 3:
        root = "C:" + end;
        S = root + end;
        break;
    }
    dir = root + (subDir != null ? (subDir + end) : "");
    Component.Message = S;
# ---------- f_pathg: C# additional code ----------
  void initComp(){
    Component.Name = "Path Generator";
    Component.NickName = "f_PathG";
    Component.Description = "generates a path based on local direcories such as Desktop, Documents, GH file path";
    Component.Params.Input[0].Name = "dir type";
    Component.Params.Input[0].Description = "directory type: 0 desktop, 1 documents, 2 GH file path, 3 C:\nconnect a value list for automatic list generation";
    Component.Params.Input[1].Name = "custom subdir";
    Component.Params.Input[1].Description = "(optional) custom subdirectory";
  }
# ---------- end f_pathg ----------
concat = Concatenate(FragmentA=f_pathg, FragmentB="AgentSystem.cs")
panel = Panel(concat)
path = FilePath(concat)
number_slider = Slider(500, range=1..3000)
# https://developer.rhino3d.com/ - Rhino developer home page
# 
# https://developer.rhino3d.com/api/ - API references
# 
# http://developer.rhino3d.com/guides/rhinocommon/what-is-rhinocommon/
# 
# https://developer.rhino3d.com/api/RhinoCommon - RhinoCommon SDK
# 
# https://developer.rhino3d.com/api/grasshopper - Grasshopper SDK
rectangle = Rectangle(Plane=PlaneXY(0, 0, 0), XSize="0 to 30", YSize="0 to 30", Radius=0)  # -> Rectangle, Length
rectangle_2 = Rectangle(Plane=PlaneXY(0, 0, 0), XSize="-1 to 1", YSize="-1 to 1", Radius=0)  # -> Rectangle, Length
box = DomainBox(Base=PlaneXY(0, 0, 0), X="0 to 30", Y="0 to 30", Z="0 to 30")
box_2 = DomainBox(Base=PlaneXY(0, 0, 0), X="-1 to 1", Y="-1 to 1", Z="-1 to 1")
# <title>
# 
# <description>
# 
# code by Alessio Erioli
# 
# v 0.1
pop2d = Populate2D(Region=rectangle.Rectangle, Count=number_slider, Seed=1)
pop3d = Populate3D(Region=box, Count=number_slider, Seed=1)
pop2d_2 = Populate2D(Region=rectangle_2.Rectangle, Count=number_slider, Seed="2")
pop3d_2 = Populate3D(Region=box_2, Count=number_slider, Seed="2")
list = ValueList({"2D": 0, "3D": 1}, selected="2D")
filter = StreamFilter(Gate=list, Stream0=pop2d, Stream1=pop3d)
filter_2 = StreamFilter(Gate=list, Stream0=pop2d_2, Stream1=pop3d_2)
amp = Amplitude(Vector=filter_2, Amplitude=Slider(0.3, range=0..1))
reset = Button()
go = BooleanToggle(False)
number_slider_2 = Slider(3.5, range=0..5)
multiplication = Multiplication(A=number_slider_2, B=Slider(0.25, range=0..1))
panel_2 = Panel(multiplication)
c_script = CSharpScript(
    reset=reset,
    go=go,
    P=filter,
    V=amp,
    nR=number_slider_2,
    coS=Slider(0.35, range=0..10),
    alS=Slider(9, range=0..20),
    seS=Slider(1.9, range=0..50),
    seR=multiplication)  # -> out, Ap, Av, At; inputs reset: Boolean, go: Boolean, P: list of Point3d, V: list of Vector3d, nR: Double, coS: Double, alS: Double, seS: Double, seR: Double
# ---------- c_script: C# usings ----------
using System.Threading;
using System.Threading.Tasks;
# ---------- c_script: C# ----------
        #region initialization
        // initialization
        if (reset || AgSys == null)
        {
            AgSys = new AgentSystem(P, V);

        }
        #endregion

        // update
        if (go)
        {
            // parameters update
            AgSys.NeighborhoodRadius = nR;
            AgSys.CohesionStrength = coS;
            AgSys.AlignmentStrength = alS;
            AgSys.SeparationStrength = seS;
            AgSys.SeparationRadius = seR;


            // system update
            //AgSys.Update();
            AgSys.UpdateRTree();
            // update solution
            Component.ExpireSolution(true);
        }

        // output
        GH_Point[] ptOut;
        GH_Vector[] velOut;


        AgSys.GetPtsVecs(out ptOut, out velOut);

        Ap = ptOut;
        Av = velOut;
        At = AgSys.GetAgentsTrails();
# ---------- c_script: C# additional code ----------
 

    //Agent a; // declaration


    public AgentSystem AgSys;

    public class AgentSystem
    {
        // fields
        public List<Agent> Agents;
        public double NeighborhoodRadius;
        public double SeparationRadius;
        public double CohesionStrength;
        public double AlignmentStrength;
        public double SeparationStrength;
        public double MaxSpeed;
        public double BoundingBoxSize;
        public double ContainmentStrength;

        // constructor
        public AgentSystem(List<Point3d> P, List<Vector3d> V)
        {
            Agents = new List<Agent>();

            for (int i = 0; i < P.Count; i++)
            {
                Agent a = new Agent(P[i], V[i]);
                a.Flock = this;

                Agents.Add(a);
            }

            MaxSpeed = 0.3;
            BoundingBoxSize = 30.0;
            ContainmentStrength = 1.0;
        }

        // methods
        public void Update()
        {
            //foreach (Agent a in Agents)
            Parallel.ForEach(Agents, a =>
            {
                ComputeAgentDesiredVelocity(a);
            });

            //foreach (Agent a in Agents)
            Parallel.ForEach(Agents, a =>
            {
                a.UpdateVelocityAndPosition();
            });
        }

        public void UpdateRTree()
        {
            // define and populate the RTree
            RTree rTree = new RTree();

            for (int i = 0; i < Agents.Count; i++)
                rTree.Insert(Agents[i].Position, i);

            // do the actual search

            foreach (Agent a in Agents)
            {
                List<Agent> neighbours = new List<Agent>();

                // here we write the callback function
                EventHandler<RTreeEventArgs> rTreeCallback =
                    (object sender, RTreeEventArgs args) =>
                    {
                        if (Agents[args.Id] != a)
                            neighbours.Add(Agents[args.Id]);
                    };

                // this performs the search
                rTree.Search(new Sphere(a.Position, NeighborhoodRadius), rTreeCallback);

                a.ComputeDesiredVelocity(neighbours);
            }


            //foreach (Agent a in Agents)
            Parallel.ForEach(Agents, a =>
            {
                a.UpdateVelocityAndPosition();
            });
        }

        public List<Agent> FindNeighbours(Agent a)
        {
            List<Agent> neighbours = new List<Agent>();

            foreach (Agent neighbour in Agents)
            {
                if (neighbour != a && neighbour.Position.DistanceTo(a.Position) < NeighborhoodRadius)
                    neighbours.Add(neighbour);
            }

            return neighbours;
        }


        public void ComputeAgentDesiredVelocity(Agent a)
        {
            List<Agent> neighbours = FindNeighbours(a);

            a.ComputeDesiredVelocity(neighbours);
        }

        public List<Polyline> GetAgentsTrails()
        {
            List<Polyline> outTrails = new List<Polyline>();

            foreach (Agent a in Agents)
                outTrails.Add(a.trail);

            return outTrails;
        }

        public void GetPtsVecs(out GH_Point[] pts, out GH_Vector[] vecs)
        {
            pts = new GH_Point[Agents.Count];
            vecs = new GH_Vector[Agents.Count];

            for (int i = 0; i < Agents.Count; i++)
            {
                pts[i] = new GH_Point(Agents[i].Position);
                vecs[i] = new GH_Vector(Agents[i].Velocity);
            }

            // parallel for loop:
            //Parallel.For(0, Agents.Count, i =>
            //{
            //    // parallel loop operations
            //}
            //);
        }
    }

    public class Agent
    {
        //fields
        public Point3d Position;
        public Vector3d Velocity;
        public Vector3d desiredVelocity;
        public AgentSystem Flock;
        public Polyline trail;

        // constructor
        public Agent(Point3d Position, Vector3d Velocity)
        {
            this.Position = Position;
            this.Velocity = Velocity;
            desiredVelocity = this.Velocity;
            //trail = new Polyline(); // empty polyline
            trail = new Polyline { this.Position };

            // array declaration
            //int[] iArray = new int[3];
            //int[] aArray = {0,2,4,6,7};
            // /array declaration

        }
        // methods

        public void ComputeDesiredVelocity(List<Agent> neighbours)
        {
            desiredVelocity = Vector3d.Zero;

            // containment behavior
            Containment();

            // flocking behaviors
            if (neighbours.Count > 0)
            {
                // COHESION BEHAVIOUR

                // find average neighbours position
                Point3d average = new Point3d();

                foreach (Agent neighbour in neighbours)
                    average += neighbour.Position;

                average /= neighbours.Count;

                // go there
                Vector3d cohesion = average - Position;
                desiredVelocity += cohesion * Flock.CohesionStrength;

                // ALIGNMENT BEHAVIOUR
                Vector3d alignment = Vector3d.Zero;

                foreach (Agent neighbour in neighbours)
                    alignment += neighbour.Velocity;

                alignment /= neighbours.Count;

                desiredVelocity += alignment * Flock.AlignmentStrength;

                // SEPARATION BEHAVIOUR
                Vector3d separation = Vector3d.Zero;

                foreach (Agent neighbour in neighbours)
                {
                    double distToNeigh = Position.DistanceTo(neighbour.Position);
                    if (distToNeigh < Flock.SeparationRadius)
                    {
                        Vector3d getAway = Position - neighbour.Position;
                        separation += getAway /= (getAway.Length * distToNeigh);

                    }
                }
                desiredVelocity += separation * Flock.SeparationStrength;

            }

        }

        public void Containment()
        {
            if (Position.X < 0.0)
                desiredVelocity += new Vector3d(-Position.X, 0, 0);
            else if (Position.X > Flock.BoundingBoxSize)
                desiredVelocity += new Vector3d(Flock.BoundingBoxSize - Position.X, 0, 0);

            if (Position.Y < 0.0)
                desiredVelocity += new Vector3d(0, -Position.Y, 0);
            else if (Position.Y > Flock.BoundingBoxSize)
                desiredVelocity += new Vector3d(0, Flock.BoundingBoxSize - Position.Y, 0);

            if (Position.Z < 0.0)
                desiredVelocity += new Vector3d(0, 0, -Position.Z);
            else if (Position.Z > Flock.BoundingBoxSize)
                desiredVelocity += new Vector3d(0, 0, Flock.BoundingBoxSize - Position.Z);

            desiredVelocity *= Flock.ContainmentStrength;
        }

        public void UpdateVelocityAndPosition()
        {
            // steering
            Velocity = 0.97 * Velocity + 0.03 * desiredVelocity;

            // limit velocity
            if (Velocity.Length > Flock.MaxSpeed)
            {
                Velocity.Unitize();
                Velocity *= Flock.MaxSpeed;
            }

            Position += Velocity;
            // adds new position to the trail
            trail.Add(Position);
        }
    }
# ---------- end c_script ----------
ftsv2 = FileToScriptV2(File=path)
crv = Curve(c_script.At)
vdisex = VectorDisplayEx(Point=c_script.Ap, Vector=c_script.Av, Colour=RGB(0, 0, 0), Width=2)
# V
# P
preview = CustomPreview(
    Geometry=crv,
    Material={diffuse=RGB(221, 160, 221), emission=RGB(66, 48, 66), shine=0.5, specular=RGB(255, 255, 255), transparency=0})
