# Grasshopper definition CS_06_RTree point search.gh (Grasshopper 1.0.7)
# Copyright: Co-de-iT

number_slider = Slider(20000, range=10..20000)
mesh = Mesh(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)

# ---- group: random field points
random_populate_mesh = CSharpScript(M=mesh, n=number_slider, s="2")  # -> Pts; inputs M: Mesh, V: Mesh, n: Int32, s: Int32
# ---------- random_populate_mesh: C# usings ----------
using System.IO;
using System.Linq;
using System.Data;
using System.Drawing;
using System.Reflection;
using System.Windows.Forms;
using System.Xml;
using System.Xml.Linq;
using System.Runtime.InteropServices;

using Rhino.DocObjects;
using Rhino.Collections;
using GH_IO;
using GH_IO.Serialization;
# ---------- random_populate_mesh: C# ----------
    Random r = new Random(s);
    BoundingBox b = new BoundingBox(M.Vertices.ToPoint3dArray());
    Point3d max = b.Max;
    Point3d min = b.Min;
    double x,y,z;
    int count = 0, i = 0;
    List<Point3d> pts = new List<Point3d>();
    List<Point3d> ptsOut = new List<Point3d>();

    while (count < n){

      x = b.Min.X + r.NextDouble() * (b.Max.X - b.Min.X);
      y = b.Min.Y + r.NextDouble() * (b.Max.Y - b.Min.Y);
      z = b.Min.Z + r.NextDouble() * (b.Max.Z - b.Min.Z);
      Point3d p = new Point3d(x, y, z);

      if (M.IsPointInside(p, 0.1, false) && (V == null ? true : !V.IsPointInside(p, 0.1, false))){
        pts.Add(p);
        count++;
      } else{
        ptsOut.Add(p);
      }

      i++;
    }

    Pts = pts;
# ---------- end random_populate_mesh ----------

# ----
subtraction = Subtraction(A=number_slider, B=Slider(500, range=100..1500))
# CS_06_RTree point search
# 
# Showing neighbour cpoints search with and without RTree - introduction to anonymous function syntax
# 
# code by Alessio Erioli
# 
# v 0.1
# RTRee search function
cloud = CloudDisplay(Points=random_populate_mesh, Colours=RGB(0, 0, 0), Size=0.03, SpriteType=0)
reduce = RandomReduce(List=random_populate_mesh, Reduction=subtraction, Seed=1)
dots = DotDisplay(Point=reduce, Colour=RGB(255, 255, 255), Size=0.03)
use_rtree = BooleanToggle(True)

# ---- group: find neighbours (RTree)
# RTRee is a spatial sorting structure, it dramatically improves results in case of many short-range searches. If you try long span searches, the sheer amount of data to process makes it less desirable.
c_script = CSharpScript(P=random_populate_mesh, P0=reduce, radius=Slider(0.3, range=0..10), UseRTRee=use_rtree)  # -> out, A, B; inputs P: list of Point3d, P0: list of Point3d, radius: Double, UseRTRee: Boolean
# ---------- c_script: C# ----------
    if (P == null || P.Count == 0) return;

    pts = P;

    ptsTree.Clear();
    indTree.Clear();

    if (UseRTRee)
    {

      // declare RTree
      RTree tree = new RTree();

      // poopulate it
      for(int i = 0; i < P.Count; i++)
        tree.Insert(P[i], i);

      // perform search

      // option 1.1: EventHandler declared on the fly
      EventHandler<RTreeEventArgs> rTreeCallback = (object sender, RTreeEventArgs e) =>
        {
        cl.Add(pts[e.Id]);
        ci.Add(e.Id);
        };
      // option 1.1 & 1.2: call to external function
      for (int i = 0; i < P0.Count; i++)
      {
        cl.Clear();
        ci.Clear();
        tree.Search(new Sphere(P0[i], radius), rTreeCallback);
        ptsTree.AddRange(cl, new GH_Path(i));
        indTree.AddRange(ci, new GH_Path(i));

      }

      //    option 2: use embedded anonymous function with lambda syntax
      //    tree.Search(new Sphere(P0, radius), (object sender, RTreeEventArgs e) =>
      //      {
      //      cl.Add(pts[e.Id]);
      //      ci.Add(e.Id);
      //      });
    }
    else
    {
      for (int i = 0; i < P0.Count; i++)
      {
        cl.Clear();
        ci.Clear();
        for (int j = 0; j < pts.Count; j++)
        {
          if (pts[j].DistanceTo(P0[i]) < radius)
          {
            cl.Add(pts[j]);
            ci.Add(j);
          }
        }
        ptsTree.AddRange(cl, new GH_Path(i));
        indTree.AddRange(ci, new GH_Path(i));
      }
    }

    A = ptsTree;
    B = indTree;
# ---------- c_script: C# additional code ----------
  List<Point3d> cl = new List<Point3d>();
  List<int> ci = new List<int>();
  List<Point3d> pts = new List<Point3d>();
  DataTree<Point3d> ptsTree = new DataTree<Point3d>();
  DataTree<int> indTree = new DataTree<int>();

  // option 1.2: declare callback function as an external one
  //  private void rTreeCallback(object sender, RTreeEventArgs e){
  //    cl.Add(pts[e.Id]);
  //    ci.Add(e.Id);
  //  }
# ---------- end c_script ----------

# ----
cloud_2 = CloudDisplay(Points=c_script.A, Colours=RGB(255, 20, 147), Size=0.05, SpriteType=0)
ln = Line(StartPoint=graft(reduce), EndPoint=c_script.A)
