# Grasshopper definition Mesh base treatment.gh (Grasshopper 1.0.7)
# Copyright: Co-de-iT
# plug-ins: MeshEdit Components, Weaverbird, Noise 4D

# ---- group: low poly mesh
mesh = Mesh(<mesh referenced from the Rhino model>)

# ----
weldvertices = MeshWeldVertices(Mesh=mesh, Tolerance=0.01)  # -> RuntimeMessage, Mesh
wbsplitquads = WeaverbirdsConstantQuadsSplitSubdivision(MeshCurves=weldvertices.Mesh, Level=Slider(2, range=1..3), SmoothNakedEdges="2")
number_slider = Slider(0.066, range=0..1)
number_slider_2 = Slider(0.25, range=0..10)
wbcatmullclark = WeaverbirdsCatmullClarkSubdivision(MeshCurves=wbsplitquads, Level=Slider(3, range=1..3), SmoothNakedEdges=1)
# <title>
# 
# <description>
# 
# code by Alessio Erioli
# 
# v 0.1
demesh = DeconstructMesh(Mesh=wbcatmullclark)  # -> Vertices, Faces, Colours, Normals
simplex = SimplexNoise(Values=demesh.Vertices, Time=number_slider_2, Scale=number_slider)
perlin = PerlinNoise(Values=demesh.Vertices, Time=number_slider_2, Scale=number_slider)
num = Number(simplex)
pi = Pi(Factor=1)
Z = UnitZ(Factor=1)
multiplication = Multiplication(A=num, B=pi, C=Slider(3, range=0..10))
xprod = CrossProduct(VectorA=demesh.Normals, VectorB=Z, Unitize=True)  # -> Vector, Length
gradient = Gradient(LowerLimit="-1", UpperLimit=1, Parameter=num, stops=[0: RGB(0, 0, 0), 1: RGB(255, 255, 255)])
vrot = Rotate(Vector=xprod.Vector, Axis=demesh.Normals, Angle=multiplication)
col = Colour(gradient)
vec = Vector(vrot)

amp = Amplitude(Vector=vec, Amplitude=Slider(0.59, range=0..1))
vdisex = VectorDisplayEx(Point=demesh.Vertices, Vector=amp, Colour=RGB(0, 0, 0), Width="1")

unit = UnitVector(Vector=vec)
col_2 = Colour(unit)
conmesh = ConstructMesh(Vertices=demesh.Vertices, Faces=demesh.Faces, Colours=col)
conmesh_2 = ConstructMesh(Vertices=demesh.Vertices, Faces=demesh.Faces, Colours=col_2)

# ---- group: Ms
# Internalize data and copy/paste into agent body gh definition
mesh_2 = Mesh(conmesh)

# ---- group: Mv
mesh_3 = Mesh(conmesh_2)
