# Grasshopper definition Post-Processing_Dendro.gh (Grasshopper 1.0.7)
# Copyright: Co-de-iT
# plug-ins: DendroGH

# ---- group: your curves from Agent_Bodies
# 00 README FIRST
# 01 operating instructions
# Isomeshing is a technique to generate a mesh surface that represents all the same values of a certain spatial field. "iso" is a prefix of Greek origins, meaning "equal".
# 
# You are certainly familiar with the concept of height contour curves on a surface, representing all points that share the same heights; just imagine the same but expanded into a 3-dimensional space. If you think about the distribution of heat in a room, what you get are isosurfaces for any particular heat value you might pick.
# 
# Isomeshing is widely applied in topological optimization: in this case the isosurfaces (or isomeshes) represent isovalues of stress, meaning that all te points in an isosurface share the same stress value.
# 
# The basic technique to generate an isomesh is an algorithm called Marching Cubes: the 3-dimensional space is discretized into voxels (volumetric pixels - think about a 3D grid of small cubes), and for each voxel the field value on the vertices is tested against a target isovalue. According to the possible cases, mesh faces are drawn for each of these voxels; the result is the final mesh. See: https://www.youtube.com/watch?v=B_xk71YopsA
# 
# Dendro, the plugin you are using in this definition, improves on that same concept in a more sophisticated way, but the control parameters and their effect work in the same way.
# 
# / / /
# 
# General considerations
# 
# . discretizations always trade accuracy for speed: the higher the resolution (number of voxels), the longer the calculation time
# 
# . first set up your system parameters working on a part of your global geometry (faster calculations), then, once happy with your settings, proceed to process the whole data
# 
# . parameters are scale-dependent: the parameters you will find in this definition have been already fine-tuned for the basic bounding box of 40 Rhino units per side. The preferred option is to scale your import model in order to fit inside the limits of this box, tweak and generate your isomeshes and then scale back the result.
# 0. import your stuff (agent bodies polylines + mesh)
# 
# 1. set the "what to process" selector to "Partial list"
# 
# 2. move the selection point with the gumball and regulate the search radius so to get a significant sample of your agent formation (check this example for reference)
# 
# 3. If happy with your choice toggle "compute isomesh" to True and wait a bit (isomeshing can take a while).
# 
# 4. Time to evaluate your output:
# . If you get an invalid mesh (or both invalid): turn "compute isomesh" to False, go to the troubleshooting section, try some of the suggested changes and go back to point 3
# . If you get both valid meshes, good! Proceed to next step
# 
# 5. Use the bake button at the far right (yellow circular group): this will automatically bake both meshes and the statistics (as text), all in separate layers (agent bodies, wrap surface, text); keep the baked results arranged in tables.
# 
# 5. Experiment with the parameters (see setings and parameters section), then restart from point 3
# 
# 6. When you've found the right parameters set for you:
# . switch "compute isomesh"to False
# . set the "what to process" selector to "full data"
# . switch "compute isomesh"to True
# . wait for it (it might take a minute or so)
# 
# 7. Finally, use the bake button at the far right to bake your global outcome.
# import agent bodies >>
crv = Curve(Tree({0}: [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], {1}: [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], {2}: [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], {3}: [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], {4}: [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], {5}: [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]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))

# ---- group: your base mesh from Agent_Bodies
# import mesh >>
mesh = Mesh(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)

# ---- group: selection point
pt = Point(Point(23.72807776, 15.0169558, 4.62768902))

# ----
search_radius = Slider(6, range=0..10)

what_to_process = ValueList({"Full data": 0, "Partial list": 1}, selected="Partial list")
compute_isomesh = BooleanToggle(False)

bake = Button()

# ---- group: select partial mesh / selection radius sphere
msphere = MeshSphere(Base=pt, Radius=search_radius, UCount=10, VCount=20)

# ---- group: select partial mesh
# This index might vary, make sure you select the right mesh portion
msplit = MeshSplit(Mesh=mesh, Splitters=msphere)
item = ListItem(List=msplit, Index="1", Wrap=True)

# ----
filter = StreamFilter(Gate=what_to_process, Stream0=mesh, Stream1=item)
swatch = ColourSwatch(SwatchColor=RGB(150, 112, 120))
swatch_2 = ColourSwatch(SwatchColor=RGBA(227, 207, 163, 93))
gate = StreamGate(Stream=filter, Gate=compute_isomesh)  # -> Target0, Target1
preview = CustomPreview(Geometry=gate.Target0, Material=swatch_2)
panel = Panel("""Voxel Size: 
Radius Multiplier: 
Curve Radius: 
Bandwidth: 
Isovalue: 
Adaptivity: """)
justification = ValueList({"Top Left": 1, "Top Center": 2, "Top Right": 3, "Middle Left": 4, "Middle Center": 5, "Middle Right": 6, "Bottom Left": 7, "Bottom Center": 8, "Bottom Right": 9}, selected="Top Left")
panel_2 = Panel("""agent bodies
wrap surface""")
merge = Merge(Data1=ColourSwatch(SwatchColor=RGB(0, 0, 0)), Data2=ColourSwatch(SwatchColor=RGB(194, 159, 70)))
and = GateAnd(A=compute_isomesh, B=bake)
font = Panel("Arial")
layer = Panel("text")

# ---- group: Dendro Volume Settings
# tentative isomesh
radius_multiplier = Slider(1.5, range=1.5..3)
# radius
number_slider = Slider(0.04, range=0.01..1)
number_slider_2 = Slider(0.3, range=0..3)
# 03 troubleshooting
# 02 settings and parameters
number_slider_3 = Slider(0.001, range=0..1)
# IN CASE OF INVALID MESH OUTPUT
# 
# 1. try to increase the Isovalue to 0.001 or 0.002
# 
# 2. if that doesn't do the trick, leave at 0 or 0.001 and increase the radius multiplier (use 0.01 increments or less)
# 
# 3. if the resulting mesh is too "puffy" decrease voxel size (this is a last resort measure - ideally it should never come to this)
# PARAMETERS
# 
# Voxel Size: the most important parameter, controls the resolution of your output isomesh. The smaller the value, the higher the resolution (and the number of voxels). Check the voxel statistics panel for the numbers.
# 
# Radius Multiplier: Curve Radius is calculated as a multiple of the Voxel size. To thicken a curve, the radius should be larger than a single voxel; hence, the radius multiplier makes curve radius a multiple of the voxel size, in a range 1.5x to 3x. See Curve Radius explanation diagram.
# 
# Isovalue: the reference value at which the mesh is calculated. Change value only in case of invalid output.
# 
# / / /
# 
# SETTINGS INDICATIONS
# 
# Parameters such as Voxel Size depend from the Bounding Box size of your Agent Bodies curves in space. The default values are conceived to work for a 40 x 40 x 40 Rhino units bounding box (the 20x20 m base at 1:50 scale). If your bounding box size is different, scale your object so that the longest size of its bounding box is approximately 40 Rhino units.
# 
# If you stick to the previous rule, the main parameter to act upon is the radius multiplier.
# 
# WORK CLOSE TO THE ORIGIN - the closer the better, ideally your object should be centered in the origin. It is always possible to move the output later, after the isomesh is generated.
# 
# Start with the standard values and take it from there.
# 
# NOTES: the agent bodies should have presence, be noticeable, but neither become "puffy" (with exccessive isomeshing masking their shape), nor excessively thin objects (little to no fusion between them occurs).
number_slider_4 = Slider(0, range=0..1)
vsettings = CreateSettings(VoxelSize=number_slider, Bandwidth=number_slider_2, Isovalue=number_slider_3, Adaptivity=number_slider_4)
multiplication = Multiplication(A=radius_multiplier, B=number_slider)
curve_radius = Panel(multiplication)

# ----
one_over_x = OneOverX(Value=number_slider)

# ---- group: select part of the bodies list
# Post processing Dendro
# 
# post process Agent Bodies to compute isomeshes for rendering
# 
# code by Alessio Erioli
# 
# v 0.1
end = EndPoints(Curve=crv)  # -> Start, End
item_2 = ListItem(List=end.Start, Index=0, Wrap=True)  # -> flatten(Item)

# ---- group: select part of the bodies list / find neighbours (RTree)
c_script = CSharpScript(P=item_2, P0=pt, radius=search_radius)  # -> out, A, B; inputs P: list of Point3d, P0: Point3d, radius: Double
# ---------- c_script: C# usings ----------
using System.IO;
using System.Linq;
using System.Data;
using System.Drawing;
using System.Reflection;
using System.Windows.Forms;
using System.Xml;
using System.Xml.Linq;
using System.Runtime.InteropServices;

using Rhino.DocObjects;
using Rhino.Collections;
using GH_IO;
using GH_IO.Serialization;
# ---------- c_script: C# ----------
    if (P == null || P.Count == 0) return;

    pts = P;
    cl.Clear();
    ci.Clear();

    // declare RTree
    RTree tree = new RTree();

    // poopulate it
    for(int i = 0; i < P.Count; i++)
      tree.Insert(P[i], i);

    // perform search
    
    // option 1.1: EventHandler declared on the fly
    EventHandler<RTreeEventArgs> rTreeCallback = (object sender, RTreeEventArgs e) =>
      {
      cl.Add(pts[e.Id]);
      ci.Add(e.Id);
      };
    // option 1.1 & 1.2: call to external function
    tree.Search(new Sphere(P0, radius), rTreeCallback);

    //    option 2: use embedded anonymous function with lambda syntax
    //    tree.Search(new Sphere(P0, radius), (object sender, RTreeEventArgs e) =>
    //      {
    //      cl.Add(pts[e.Id]);
    //      ci.Add(e.Id);
    //      });

    A = cl;
    B = ci;
# ---------- c_script: C# additional code ----------
  List<Point3d> cl = new List<Point3d>();
  List<int> ci = new List<int>();
  List<Point3d> pts = new List<Point3d>();


  // option 1.2: declare callback function as an external one
  //  private void rTreeCallback(object sender, RTreeEventArgs e){
  //    cl.Add(pts[e.Id]);
  //    ci.Add(e.Id);
  //  }
# ---------- end c_script ----------

# ---- group: select part of the bodies list (continued)
branch = TreeBranch(Tree=simplify(crv), Path=c_script.B, MaintainPaths=True)

# ----
filter_2 = StreamFilter(Gate=what_to_process, Stream0=crv, Stream1=branch)  # -> flatten(Stream)
gate_2 = StreamGate(Stream=filter_2, Gate=compute_isomesh)  # -> Target0, Target1
bbox = BoundingBox(Content=filter_2, Plane=PlaneXY(0, 0, 0), UnionBox=True)  # -> Box, Box_2
preview_2 = CustomPreview(Geometry=gate_2.Target0, Material=swatch)

# ---- group: compute agent bodies isomesh
vcurve = CurveToVolume(Curves=gate_2.Target1, CurveRadius=multiplication, Settings=vsettings)
list = ValueList({"Gaussian": 0, "Laplacian": 1, "Mean": 2, "Median": 3}, selected="Median")
vsmooth = SmoothVolume(Volume=vcurve, Width=1, Type=list, Iterations=Slider(1, range=1..10))
mvolume = VolumeToMesh(Volume=vsmooth, VolumeSettings=vsettings)

# ---- group: compute surface wrap isomesh
# keep this value in the 0.02-0.03 range
number_slider_5 = Slider(0.02, range=0.01..0.03)
vmesh = MeshToVolume(Mesh=gate.Target1, Settings=vsettings)
vunion = VolumeUnion(Volumes=flatten([vmesh, vsmooth]))
voffset = OffsetVolume(Volume=vunion, Distance=number_slider_5)
mvolume_2 = VolumeToMesh(Volume=voffset, VolumeSettings=vsettings)

# ----
box = EvaluateBox(Box=bbox.Box, UParameter="0", VParameter="0", WParameter="0")  # -> Plane, Point, Include
boxprop = BoxProperties(Box=bbox.Box)  # -> Center, Diagonal, Area, Volume, Degeneracy
c_script_2 = CSharpScript(D=boxprop.Diagonal, s=one_over_x)  # -> A; inputs D: Vector3d, s: Double
# ---------- c_script_2: C# ----------
    int x,y,z,t;

    x = (int) Math.Floor(D.X * s);
    y = (int) Math.Floor(D.Y * s);
    z = (int) Math.Floor(D.Z * s);
    t = x * y * z;

    A = String.Format("\n{0:0,0} Cells\nX:{1} Y:{2} Z:{3}", t, x, y, z);
# ---------- end c_script_2 ----------

# ---- group: Dendro Volume Settings (continued)
# curve
voxel_statistics = Panel(c_script_2)

# ----
merge_2 = Merge(
    Data1=number_slider,
    Data2=radius_multiplier,
    Data3=multiplication,
    Data4=number_slider_2,
    Data5=number_slider_3,
    Data6=number_slider_4,
    Data7=c_script_2)
concat = Concatenate(FragmentA=panel, FragmentB=merge_2)

# ---- group: surface wrap mesh
mesh_2 = Mesh(mvolume_2)

# ---- group: agent bodies mesh
mesh_3 = Mesh(mvolume)

# ----
agent_bodies_mesh = Panel(mesh_3)
surface_wrap_mesh = Panel(mesh_2)

join = TextJoin(Text=concat)
panel_3 = Panel(join)
merge_3 = Merge(Data1=mesh_3, Data2=mesh_2)

# ---- group: squash planes to XY
c_script_3 = CSharpScript(P=box.Plane)  # -> P0; inputs P: Plane
# ---------- c_script_3: C# ----------
    P.OriginZ = 0;
    P0 = P;
# ---------- end c_script_3 ----------

# ----
# in case of invalid mesh check the troubleshooting section
preview_3 = CustomPreview(Geometry=mesh_3, Material=swatch)
# in case of invalid mesh check the troubleshooting section
preview_4 = CustomPreview(Geometry=mesh_2, Material=swatch_2)

# ---- group: statistics tag
tag = TextTag3D(Location=c_script_3, Text=join, Size="0.5", Justification=justification)

# ---- group: bake meshes
f_bakeatt = BakeAttributesEnhanced(obj=merge_3, layer=panel_2, lColor=merge, bake_iT=and)  # -> info; inputs obj: GeometryBase, name: String, layer: String, lColor: Color, color: Color, pWidth: Double, wires: Int32, group_n: Int32, group: Boolean, bake_iT: Boolean
#   port layer: Layer name for the object if the layer doesn't exist, it will be created
#   port group: Performs bake operation attach a button here and click to bake
# ---------- f_bakeatt: C# ----------
                                                                                                            /*
    froGH - a sparse collection of (in)utilities for Grasshopper

    Bake Attributes ++
    Original Version Written by Giulio Piacentino - 2010 11 21 - for Grasshopper 0.8.002
    Enhanced by Co-de-iT (Alessio) - now bakes on chosen layer(s) and in groups

    froGH by Co-de-iT is licensed under a Creative Commons Attribution 4.0 International License.
    http://creativecommons.org/licenses/by/4.0/

    */

    initComp();

    if (obj == null)
    {
      Print("No object to bake");
      return;
    }

    if (bake_iT)
    {
      /*
      if(obj == null)
      {
        Print("No object to bake");
        return;
      }
 */

      //Make new attribute to set name
      Rhino.DocObjects.ObjectAttributes att = new Rhino.DocObjects.ObjectAttributes();

      //Set object name
      if(!string.IsNullOrEmpty(name))
      {
        att.Name = name;
      }

      //Set color
      if(!color.IsEmpty)
      {
        att.ColorSource = Rhino.DocObjects.ObjectColorSource.ColorFromObject; //Make the color type "by object"
        att.ObjectColor = color;

        att.PlotColorSource = Rhino.DocObjects.ObjectPlotColorSource.PlotColorFromObject; //Make the plot color type "by object"
        att.PlotColor = color;
      }

      // Set group

      if(group)
      {
        doc.Groups.Add(Convert.ToString(group_n));
        att.AddToGroup(group_n);

      }

      //Set layer
      if(!string.IsNullOrEmpty(layer) && Rhino.DocObjects.Layer.IsValidName(layer))
      {
        //Get the current layer index
        Rhino.DocObjects.Tables.LayerTable layerTable = doc.Layers;
        //int layerIndex = layerTable.Find(layer, true);
        int layerIndex = layerTable.FindByFullPath(layer, -1);

        if(layerIndex < 0) //This layer does not exist, we add it
        {
          Rhino.DocObjects.Layer onlayer = new Rhino.DocObjects.Layer(); //Make a new layer
          onlayer.Name = layer;
          onlayer.Color = lColor.IsEmpty ? Color.Black : lColor; //Color.Gainsboro; // sets new layer color - future dev: choose new layers color

          layerIndex = layerTable.Add(onlayer); //Add the layer to the layer table
          if (layerIndex > -1) //We managed to add the layer!
          {
            att.LayerIndex = layerIndex;
            Print("Added new layer to the document at position " + layerIndex + " named " + layer + ". ");
          } else
            Print("Layer did not add. Try cleaning up your layers."); //This never happened to me.
        }
        else
          att.LayerIndex = layerIndex; //We simply add to the existing layer
      }


      //Set plotweight
      if(pWidth > 0)
      {
        att.PlotWeightSource = Rhino.DocObjects.ObjectPlotWeightSource.PlotWeightFromObject;
        att.PlotWeight = pWidth;
      }


      //Set material
      bool materialByName = !string.IsNullOrEmpty(material as string);
      Rhino.Display.DisplayMaterial inMaterial = material as Rhino.Display.DisplayMaterial;
      if(material is Color)
      {
        inMaterial = new Rhino.Display.DisplayMaterial((Color) material);
      }
      if(material != null && inMaterial == null && !materialByName)
      {
        if(!(material is string))
        {
          try //We also resort to try with IConvertible
          {
            inMaterial = (Rhino.Display.DisplayMaterial) Convert.ChangeType(material, typeof(Rhino.Display.DisplayMaterial));
          }
          catch(InvalidCastException)
          {
          }
        }
      }
      if(inMaterial != null || materialByName)
      {
        string matName;

        if(!materialByName)
        {
          matName = string.Format("D:{0}-E:{1}-S:{2},{3}-T:{4}",
            Format(inMaterial.Diffuse),
            Format(inMaterial.Emission),
            Format(inMaterial.Specular),
            inMaterial.Shine.ToString(),
            inMaterial.Transparency.ToString()
            );
        }
        else
        {
          matName = (string) material;
        }

        int materialIndex = doc.Materials.Find(matName, true);
        if(materialIndex < 0 && !materialByName) //Material does not exist and we have its specs
        {
          materialIndex = doc.Materials.Add(); //Let's add it
          if(materialIndex > -1)
          {
            Print("Added new material at position " + materialIndex + " named \"" + matName + "\". ");
            Rhino.DocObjects.Material m = doc.Materials[materialIndex];
            m.Name = matName;
            m.DiffuseColor = inMaterial.Diffuse;
            m.EmissionColor = inMaterial.Emission;
            //m.ReflectionColor = no equivalent
            m.SpecularColor = inMaterial.Specular;
            m.Shine = inMaterial.Shine;
            m.Transparency = inMaterial.Transparency;
            //m.TransparentColor = no equivalent
            m.CommitChanges();

            att.MaterialSource = Rhino.DocObjects.ObjectMaterialSource.MaterialFromObject;
            att.MaterialIndex = materialIndex;
          }
          else
            Print("Material did not add. Try cleaning up your materials."); //This never happened to me.
        }
        else if(materialIndex < 0 && materialByName) //Material does not exist and we do not have its specs. We do nothing
        {
          Print("Warning: material name not found. I cannot set the source to this material name. Add a material with name: " + matName);
        }
        else
        {
          //If this material exists, we do not replace it!
          att.MaterialSource = Rhino.DocObjects.ObjectMaterialSource.MaterialFromObject;
          att.MaterialIndex = materialIndex;
        }
      }


      //Set wire density
      if(wires == -1 || wires > 0)
      {
        att.WireDensity = wires;
      }


      //Bake to the right type of object
      switch(obj.ObjectType)
      {
        case Rhino.DocObjects.ObjectType.Brep:
          doc.Objects.AddBrep(obj as Brep, att);
          break;
        case Rhino.DocObjects.ObjectType.Curve:
          doc.Objects.AddCurve(obj as Curve, att);
          break;
        case Rhino.DocObjects.ObjectType.Point:
          doc.Objects.AddPoint((obj as Rhino.Geometry.Point).Location, att);
          break;
        case Rhino.DocObjects.ObjectType.Surface:
          doc.Objects.AddSurface(obj as Surface, att);
          break;
        case Rhino.DocObjects.ObjectType.Mesh:
          doc.Objects.AddMesh(obj as Mesh, att);
          break;
        case Rhino.DocObjects.ObjectType.Extrusion:
          typeof(Rhino.DocObjects.Tables.ObjectTable).InvokeMember("AddExtrusion", BindingFlags.Instance | BindingFlags.InvokeMethod, null, doc.Objects, new object[]{obj, att});
          break;
        case Rhino.DocObjects.ObjectType.PointSet:
          doc.Objects.AddPointCloud(obj as Rhino.Geometry.PointCloud, att); //This is a speculative entry
          break;
        default:
          Print("The script does not know how to handle this type of geometry: " + obj.GetType().FullName);
          break;
      }
      Print("Added " + obj.GetType().Name);

    }
    else
    {
      Print("Inactive");
    }
    //obj_out = obj;
# ---------- f_bakeatt: C# additional code ----------
  void initComp(){

    Component.Name = "Bake Attributes Enhanced";
    Component.NickName = "f_BakeAtt++";
    Component.Description = "Bakes objects with attributes such as color, material, layer, object name, wire density. Option to bake in groups";
    Component.Params.Input[0].Name = "Object";
    Component.Params.Input[0].Description = "Object to bake";
    Component.Params.Input[1].Name = "Object name";
    Component.Params.Input[1].Description = "A custom name for the object";
    Component.Params.Input[2].Name = "Object Layer";
    Component.Params.Input[2].Description = "Layer name for the object\nif the layer doesn't exist, it will be created";
    Component.Params.Input[3].Name = "Object Color";
    Component.Params.Input[3].Description = "Color of baked object";
    Component.Params.Input[4].Name = "Print Width";
    Component.Params.Input[4].Description = "Print width";
    Component.Params.Input[5].Name = "Wire density";
    Component.Params.Input[5].Description = "Density of wires for display";
    Component.Params.Input[6].Name = "Material";
    Component.Params.Input[6].Description = "Object custom material";
    Component.Params.Input[7].Name = "Group Number";
    Component.Params.Input[7].Description = "Number of the group for the object\n(in case group option is active)";
    Component.Params.Input[8].Name = "Group Objects";
    Component.Params.Input[8].Description = "Bake objects in groups according to the group number for each object";
    Component.Params.Input[9].Name = "Bake it!";
    Component.Params.Input[9].Description = "Performs bake operation\nattach a button here and click to bake";
    Component.Params.Output[0].Name = "Info";
    Component.Params.Output[0].Description = "Info on the bake process/result";

  }

  static string Format(Color c)
  {
    return (new System.Text.StringBuilder("A")).Append(c.A.ToString()).Append("R").Append(c.R.ToString()).Append("G")
      .Append(c.G.ToString()).Append("B").Append(c.B.ToString()).ToString();
  }
# ---------- end f_bakeatt ----------

# ---- group: Bake Text
c_script_4 = CSharpScript(P=c_script_3, T=join, L=layer, S="0.5", F=font, J=justification, bake=and)  # inputs P: Plane, T: String, L: String, S: Double, F: String, C: Color, J: Int32, bake: Boolean
# ---------- c_script_4: C# usings ----------
using Rhino.DocObjects;
using System.Drawing;
# ---------- c_script_4: C# ----------
    if(P == null || T == null || S <= 0) return;
    var tj = TextJustification.TopLeft;

    if(bake)
    {

      switch (J)
      {
        case 1:
          tj = TextJustification.TopLeft;
          break;
        case 2:
          tj = TextJustification.TopCenter;
          break;
        case 3:
          tj = TextJustification.TopRight;
          break;
        case 4:
          tj = TextJustification.MiddleLeft;
          break;
        case 5:
          tj = TextJustification.MiddleCenter;
          break;
        case 6:
          tj = TextJustification.MiddleRight;
          break;
        case 7:
          tj = TextJustification.BottomLeft;
          break;
        case 8:
          tj = TextJustification.BottomCenter;
          break;
        case 9:
          tj = TextJustification.BottomRight;
          break;
        default:
          break;
      }

      //    TextEntity text = new TextEntity();
      //    text.Font = new Rhino.DocObjects.Font(F);
      //    text.PlainText = T;
      //    text.TextHeight = S;
      //    text.Justification = tj;


      //Make new attribute to set, well... attributes
      ObjectAttributes att = new ObjectAttributes();


      //Set color
      if(!C.IsEmpty)
      {
        att.ColorSource = ObjectColorSource.ColorFromObject; //Make the color type "by object"
        att.ObjectColor = C;

        att.PlotColorSource = ObjectPlotColorSource.PlotColorFromObject; //Make the plot color type "by object"
        att.PlotColor = C;
      }

      //Set layer
      if(!string.IsNullOrEmpty(L) && Layer.IsValidName(L))
      {
        //Get the current layer index
        Rhino.DocObjects.Tables.LayerTable layerTable = RhinoDoc.ActiveDoc.Layers;
        // Rhino.DocObjects.Tables.LayerTable layerTable = doc.Layers;
        int layerIndex = layerTable.FindByFullPath(L, -1);


        if(layerIndex < 0) //This layer does not exist, we add it
        {
          Layer onlayer = new Layer(); //Make a new layer
          onlayer.Name = L;
          onlayer.Color = Color.Black; //Color.Gainsboro; // sets new layer color - future dev: choose new layers color

          layerIndex = layerTable.Add(onlayer); //Add the layer to the layer table
          if (layerIndex > -1) //We managed to add the layer!
          {
            att.LayerIndex = layerIndex;
            Print("Added new layer to the document at position " + layerIndex + " named " + L + ". ");
          } else
            Print("Layer did not add. Try cleaning up your layers."); //This never happened to me.
        }
        else
          att.LayerIndex = layerIndex; //We simply add to the existing layer
      }

      Rhino.RhinoDoc.ActiveDoc.Objects.AddText(T, P, S, F, false, false, tj, att);
    }
# ---------- c_script_4: C# additional code ----------
  private readonly List<string> _text = new List<string>();
  private readonly List<Point3d> _points = new List<Point3d>();
# ---------- end c_script_4 ----------
